# Grasshopper definition 3-Light Cage.gh (Grasshopper 1.0.7)

pt = ConstructPoint(XCoordinate=0, YCoordinate=0, ZCoordinate=0)
Z = UnitZ(Factor=1)
line = LineSDL(Start=pt, Direction=Z, Length=Slider(100, range=0..100))
divide = DivideCurve(Curve=reparameterize(line), Count=10, Kinks=False)  # -> Points, Tangents, Parameters
graph = GraphMapper(
    divide.Parameters,
    x0=0,
    x1=1,
    y0=0,
    y1=1,
    container_name="Bezier",
    cpx=[0, 0.4176812768, 0.5802895427, 1],
    cpy=[0, 0, 1, 1])
dom = ConstructDomain(DomainStart=Slider(100, range=0..100), DomainEnd="0")
remap = RemapNumbers(Value=graph, Source=Domain(0, 1), Target=dom)  # -> Mapped, Clipped
X = UnitX(Factor=remap.Mapped)
move = Move(Geometry=divide.Points, Motion=X)  # -> Geometry, Transform
